# Grasshopper definition GH_UnitNumber_Example01.gh (Grasshopper 1.0.7)
# plug-ins: UnitNumber

panel = Panel("""2.3m
4.5 cm
1.2kN
3.4 MN""")
createunit = CreateUnitNumber(Number_mm=Slider(15, range=0..100), Unit_type="Length", Measure="Millimeter")

# ---- group: Check1
un = UnitNumber(createunit)

# ---- group: Check4
un_2 = UnitNumber(panel)

# ----
convertunit = ConvertUnitNumber(UnitNumber=un, Select_output_unit="cm")
convertunit_2 = ConvertUnitNumber(UnitNumber=un, Unit="m", Select_output_unit="m")
panel_2 = Panel(un_2)

# ---- group: Check2
num = Number(convertunit)

# ---- group: Check3
num_2 = Number(convertunit_2)

# ----
panel_3 = Panel(num)
panel_4 = Panel(num_2)
