# Grasshopper definition OasysGH_InputHelperTests.gh (Grasshopper 1.0.7)
# Copyright: Arup
# plug-ins: UnitNumber

# From UnitNumber
createunit = CreateUnitNumber(Number_kN_m=Slider(2.5, range=0..10), Unit_type="Moment", Measure="KilonewtonMeter")
createunit_2 = CreateUnitNumber(Number_kN_m=Slider(2.5, range=0..10), Unit_type="Moment", Measure="KilonewtonMeter")
createunit_3 = CreateUnitNumber(Number_m=Slider(4, range=0..10), Unit_type="Length", Measure="Meter")
createunit_4 = CreateUnitNumber(Number_m=Slider(5.2, range=0..10), Unit_type="Length", Measure="Meter")
createunit_5 = CreateUnitNumber(Number_kN=Slider(4, range=0..10), Unit_type="Force", Measure="Kilonewton")
createunit_6 = CreateUnitNumber(Number_kN=Slider(5.2, range=0..10), Unit_type="Force", Measure="Kilonewton")
createunit_7 = CreateUnitNumber(Number_kN=Slider(4, range=0..10), Unit_type="Force", Measure="Kilonewton")
createunit_8 = CreateUnitNumber(Number_kN=Slider(5.2, range=0..10), Unit_type="Force", Measure="Kilonewton")
createunit_9 = CreateUnitNumber(Number=Slider(2.5, range=0..10), Unit_type="Ratio", Measure="DecimalFraction")
createunit_10 = CreateUnitNumber(Number_m=Slider(2.5, range=0..10), Unit_type="Length", Measure="Meter")
createunit_11 = CreateUnitNumber(Number_=Slider(2.5, range=0..10), Unit_type="Ratio", Measure="Percent")
createunit_12 = CreateUnitNumber(Number=Slider(2.5, range=0..10), Unit_type="Ratio", Measure="DecimalFraction")
un = UnitNumber([createunit_3, createunit_4])
un_2 = UnitNumber([createunit_5, createunit_6])
un_3 = UnitNumber([createunit_7, createunit_8])
test = TestComponent(Test_6=createunit_9)  # -> Test, Test_2
test_2 = TestComponent(Test_5=createunit_10)  # -> Test, Test_2
test_3 = TestComponent(Test_8=createunit_11)  # -> Test, Test_2
test_4 = TestComponent(Test=createunit)  # -> Test, Test_2
test_5 = TestComponent(Test_3=createunit_2)  # -> Test, Test_2
test_6 = TestComponent(LorRs=un)  # -> Test, Test_2
test_7 = TestComponent(Test_7=createunit_12)  # -> Test, Test_2
test_8 = TestComponent(Test_2=un_2)  # -> Test, Test_2
test_9 = TestComponent(Test_4=un_3)  # -> Test, Test_2

# ---- group: RatioInDecimalFractionToDecimalFractionFromUnitNumberTest
un_4 = UnitNumber(test_3.Test)

# ---- group: RatioInDecimalFractionToPercentageFromUnitNumberTest
un_5 = UnitNumber(test_7.Test)

# ---- group: UnitNumberOrDoubleAsRatioToPercentageFromUnitNumberTest
un_6 = UnitNumber(test.Test)

# ---- group: UnitNumberListInputFromUnitNumbersTest
un_7 = UnitNumber(test_8.Test_2)

# ---- group: GenericGooListInputFromUnitNumbersTest
un_8 = UnitNumber(test_9.Test_2)

# ---- group: LengthsOrRatioListInputFromUnitNumbersTest
un_9 = UnitNumber(test_6.Test_2)

# ---- group: UnitNumberInputFromUnitNumberTest
un_10 = UnitNumber(test_4.Test)

# ---- group: GenericGooInputFromUnitNumberTest
un_11 = UnitNumber(test_5.Test)

# ---- group: LengthsOrRatioInputFromUnitNumberTest
un_12 = UnitNumber(test_2.Test)

# ----
panel = Panel("""4.0kN
5.2 kN""")
panel_2 = Panel("""4.0m
5.2 m""")
# Parse from Text
panel_3 = Panel("2.5kN·m")
test_10 = TestComponent(Test_5="2.5m")  # -> Test, Test_2
test_11 = TestComponent(LorRs=panel_2)  # -> Test, Test_2
test_12 = TestComponent(Test_6="50%")  # -> Test, Test_2
test_13 = TestComponent(Test_8="50%")  # -> Test, Test_2
test_14 = TestComponent(Test_7="50%")  # -> Test, Test_2
test_15 = TestComponent(Test=panel_3)  # -> Test, Test_2
test_16 = TestComponent(Test_2=panel)  # -> Test, Test_2

# ---- group: LengthOrRatioListInputFromTextsTest
un_13 = UnitNumber(test_11.Test_2)

# ---- group: LengthOrRatioInputFromTextTest
un_14 = UnitNumber(test_10.Test)

# ---- group: UnitNumberListInputFromTextsTest
un_15 = UnitNumber(test_16.Test_2)

# ---- group: UnitNumberInputFromTextTest
un_16 = UnitNumber(test_15.Test)

# ---- group: RatioInDecimalFractionToDecimalFractionFromTextTest
un_17 = UnitNumber(test_13.Test)

# ---- group: RatioInDecimalFractionToPercentageFromTextTest
un_18 = UnitNumber(test_14.Test)

# ---- group: UnitNumberOrDoubleAsRatioToPercentageFromTextTest
un_19 = UnitNumber(test_12.Test)

# ----
num = Number([Slider(4, range=0..10), Slider(5.2, range=0..10)])
num_2 = Number([Slider(4, range=0..10), Slider(5.2, range=0..10)])
# From Double
test_17 = TestComponent(Test=Slider(2.5, range=0..10))  # -> Test, Test_2
test_18 = TestComponent(Test_2=num)  # -> Test, Test_2
test_19 = TestComponent(Test_5=Slider(2.5, range=0..10))  # -> Test, Test_2
test_20 = TestComponent(LorRs=num_2)  # -> Test, Test_2
test_21 = TestComponent(Test_6=Slider(0.5, range=0..1))  # -> Test, Test_2
test_22 = TestComponent(Test_8=Slider(0.5, range=0..1))  # -> Test, Test_2
test_23 = TestComponent(Test_7=Slider(0.5, range=0..1))  # -> Test, Test_2

# ---- group: UnitNumberListInputFromNumbersTest
un_20 = UnitNumber(test_18.Test_2)

# ---- group: UnitNumberInputFromNumberTest
un_21 = UnitNumber(test_17.Test)

# ---- group: LengthOrRatioInputFromNumberTest
un_22 = UnitNumber(test_19.Test)

# ---- group: LengthOrRatioListInputFromNumbersTest
un_23 = UnitNumber(test_20.Test_2)

# ---- group: UnitNumberOrDoubleAsRatioToPercentageFromNumberTest
un_24 = UnitNumber(test_21.Test)

# ---- group: RatioInDecimalFractionToDecimalFractionFromNumberTest
un_25 = UnitNumber(test_22.Test)

# ---- group: RatioInDecimalFractionToPercentageFromNumberTest
un_26 = UnitNumber(test_23.Test)

# ----
createunit_13 = CreateUnitNumber(Number_m=Slider(5.4, range=0..10), Unit_type="Length", Measure="Meter")
createunit_14 = CreateUnitNumber(Number_m=Slider(2.5, range=0..10), Unit_type="Length", Measure="Meter")
createunit_15 = CreateUnitNumber(Number_m=Slider(2.5, range=0..10), Unit_type="Length", Measure="Meter")
neg = Negative(Value=[Slider(0.4, range=0..1), Slider(0.52, range=0..1)])
neg_2 = Negative(Value=Slider(0.25, range=0..1))
test_24 = TestComponent(Test_5=neg_2)  # -> Test, Test_2
test_25 = TestComponent(LorRs=neg)  # -> Test, Test_2
un_27 = UnitNumber([createunit_14, createunit_13])

# ---- group: Error
test_26 = TestComponent(Test=createunit_15)  # -> Test, Test_2

# ---- group: Warning
test_27 = TestComponent(Test_2=un_27)  # -> Test, Test_2

# ---- group: LengthOrRatioInputFromNegativeNumberTest
un_28 = UnitNumber(test_24.Test)

# ---- group: LengthOrRatioListInputFromNegativeNumbersTest
un_29 = UnitNumber(test_25.Test_2)

# ----
un_30 = UnitNumber(test_27.Test)
un_31 = UnitNumber(test_26.Test)
createunit_16 = CreateUnitNumber(Number=Slider(4, range=0..10), Unit_type="Ratio", Measure="DecimalFraction")
createunit_17 = CreateUnitNumber(Number_=Slider(5.2, range=0..10), Unit_type="Ratio", Measure="Percent")
createunit_18 = CreateUnitNumber(Number_=Slider(2.5, range=0..10), Unit_type="Ratio", Measure="Percent")
un_32 = UnitNumber([createunit_16, createunit_17])
test_28 = TestComponent(Test_5=createunit_18)  # -> Test, Test_2
test_29 = TestComponent(LorRs=un_32)  # -> Test, Test_2

# ---- group: LengthOrRatioInputFromUnitNumberRatioTest
un_33 = UnitNumber(test_28.Test)

# ---- group: LengthOrRatioListInputFromUnitNumberRatiosTest
un_34 = UnitNumber(test_29.Test_2)

# ----
panel_4 = Panel("""4%
5.2 %""")
test_30 = TestComponent(Test_5="25 %")  # -> Test, Test_2
test_31 = TestComponent(LorRs=panel_4)  # -> Test, Test_2

# ---- group: LengthOrRatioInputFromTextRatioTest
un_35 = UnitNumber(test_30.Test)

# ---- group: LengthOrRatioListInputFromTextRatiosTest
un_36 = UnitNumber(test_31.Test_2)
